# Grasshopper definition GH_Challenges_A_Intro_to_Grasshopper.ghx (Grasshopper 0.9.76)

# Challenge A10: Remove the middle slider and make one new connection so that the circles gradually increase in radius.
number_slider = Slider(10, range=0..10)
# Challenge A4: Changing only the slider, set the number in the Multiplication panel to exactly 9000.
number_slider_2 = Slider(10, range=0..10)
# Grasshopper Challenges
# By Dan Taeyoung, 2016. https://github.com/provolot/GrasshopperChallenges
# Challenges A - Intro to Grasshopper
# Challenge A0: Connect the slider to the panel!
# Challenge A1: Change the slider to set the number in the panel to 7 (or 7.0).
number_slider_3 = Slider(0, range=0..10)
# Challenge A2: Set the number in the panel to exactly 3.14.
number_slider_4 = Slider(0, range=0..10)
# Challenge A8: Delete one slider and rewire components, so that one slider makes the cylinder increase/decrease in both height and diameter.
construct_point = ConstructPoint(XCoordinate=150, YCoordinate=0, ZCoordinate=0)
# Challenge A3: Changing only the slider, set the number in the panel to 50.
number_slider_5 = Slider(10, range=0..10)
# Challenge A7: Create a cylinder by only adding one 'Extrude' component, and extruding the circle with the vector (direction) pointing along the Z axis.
construct_point_2 = ConstructPoint(XCoordinate=100, YCoordinate=0, ZCoordinate=0)
# Challenge A9: Add Sliders as inputs to the 'Series' component in order to create 20 odd numbers, starting at 1. ex: "1, 3, 5.."
number_slider_6 = Slider(20, range=0..20)
# Challenge A5: Add a Slider as an input to the Circle component, and create a circle with an area larger than 300 (square units).
construct_point_3 = ConstructPoint(XCoordinate=0, YCoordinate=0, ZCoordinate=0)
# Challenge A6: Removing the Circle component and using the Polygon component instead, create a 9-sided 'nonagon'.
construct_point_4 = ConstructPoint(XCoordinate=50, YCoordinate=0, ZCoordinate=0)
series = Series(Start=0, Step=1, Count=10)

# ---- group: Remove me!
number_slider_7 = Slider(40, range=0..100)

# ----
# Challenge A11: Create a set of 10 cylinders that gradually increase both in diameter and in height.
series_2 = Series(Start=1, Step=22, Count=10)
series_3 = Series(Start=1, Step=22, Count=number_slider)
addition = Addition(A=number_slider_5, B="10")
subtraction = Subtraction(A=number_slider_2, B="-10")
division = Division(A=number_slider_2, B="-10")
multiplication = Multiplication(A=number_slider_2, B="-10")
circle = Circle(Plane=construct_point_3, Radius=1)
construct_point_5 = ConstructPoint(XCoordinate=200, YCoordinate=series_2, ZCoordinate=0)
unit_z = UnitZ(Factor=number_slider_6)
circle_2 = Circle(Plane=construct_point, Radius=Slider(7.55, range=0..10))
unit_z_2 = UnitZ(Factor=Slider(20, range=0..20))
circle_3 = Circle(Plane=construct_point_2, Radius=Slider(5, range=0..10))
construct_point_6 = ConstructPoint(XCoordinate=150, YCoordinate=series_3, ZCoordinate=0)

# ---- group: This is a panel - it helps you visualize data and geometry.
panel = Panel()

# ----
panel_2 = Panel(number_slider_4)
panel_3 = Panel(Slider(0, range=0..10))
panel_4 = Panel(addition)
panel_5 = Panel(division)
multiplication_panel = Panel(multiplication)
panel_6 = Panel(subtraction)
division_2 = Division(A=number_slider_7, B=Slider(4, range=0..10))
circle_4 = Circle(Plane=construct_point_4, Radius=Slider(5, range=0..10))
polygon = Polygon(Plane=PlaneXY(0, 0, 0), Radius=3, Segments=6, FilletRadius=0)  # -> Polygon, Length
panel_7 = Panel(series)

# ---- group: Notice how the 'Area' component also returns the center of the circle.
area = Area(Geometry=circle)  # -> Area, Centroid

# ----
extrude = Extrude(Base=circle_2, Direction=unit_z)
checker = Checker_2(data=panel_2)
checker_2 = Checker_11(data=panel)
checker_3 = Checker_3(data=panel_4)
checker_4 = Checker_7(data=series)
checker_5 = Checker(data=panel_3)
checker_6 = Checker_4(data=multiplication_panel)
checker_7 = Checker_5(data=circle_4)
# Hint:
# Double-click on the Slider on the 'Number Slider' text (or Right-click)  to edit the Slider properties.
panel_8 = Panel(checker)
panel_9 = Panel(checker_2)
panel_10 = Panel(area.Area)

# ---- group: Notice that this component just 'caps' the top and bottom of the cylinder.
cap_holes = CapHoles(Brep=extrude)

# ----
panel_11 = Panel(checker_3)
panel_12 = Panel(checker_5)
panel_13 = Panel(checker_4)
panel_14 = Panel(checker_6)
geometry = Geometry()
panel_15 = Panel(checker_7)
cone = Cone(Base=PlaneXY(0, 0, 0), Radius=0.5, Length=1)  # -> Cone, Tip
circle_5 = Circle(Plane=construct_point_6, Radius=division_2)
checker_8 = Checker_8(data=geometry)
checker_9 = Checker_6(data=area.Area)
geometry_2 = Geometry(circle_5)
geometry_3 = Geometry(cone.Cone)
# Hint:
# Search the menu above for 'Extrude'. Alternately, double-click on the Grasshopper canvas - this will bring up a search menu. Type 'Extrude', and choose the plain 'Extrude', not 'Extrude Along', etc..
panel_16 = Panel(checker_8)
panel_17 = Panel(checker_9)
checker_10 = Checker_9(data=geometry_2)
checker_11 = Checker_10(data=geometry_3)
panel_18 = Panel(checker_10)
# The 'List' in 'Sift Pattern' can take any kind of list, not just lists of numbers.
panel_19 = Panel(checker_11)

# ==== cluster Checker
data = ClusterInput()
data_2 = Data(data)
equality = Equality(FirstNumber="7", SecondNumber=data_2)  # -> Equality, Inequality
stream_filter = StreamFilter(Gate=equality.Equality, Stream0=" ", Stream1="Correct!")
data_3 = Data(stream_filter)
data_4 = ClusterOutput(data_3)

# ==== cluster Checker_2
data = ClusterInput()
data_2 = Data(data)
equality = Equality(FirstNumber="3.14", SecondNumber=data_2)  # -> Equality, Inequality
stream_filter = StreamFilter(Gate=equality.Equality, Stream0=" ", Stream1="Correct!")
data_3 = Data(stream_filter)
data_4 = ClusterOutput(data_3)

# ==== cluster Checker_3
data = ClusterInput()
data_2 = Data(data)
equality = Equality(FirstNumber="50", SecondNumber=data_2)  # -> Equality, Inequality
stream_filter = StreamFilter(Gate=equality.Equality, Stream0=" ", Stream1="Correct!")
data_3 = Data(stream_filter)
data_4 = ClusterOutput(data_3)

# ==== cluster Checker_4
data = ClusterInput()
data_2 = Data(data)
equality = Equality(FirstNumber="9000", SecondNumber=data_2)  # -> Equality, Inequality
stream_filter = StreamFilter(Gate=equality.Equality, Stream0=" ", Stream1="Correct!")
data_3 = Data(stream_filter)
data_4 = ClusterOutput(data_3)

# ==== cluster Checker_5
data = ClusterInput()
data_2 = Data(data)
explode = Explode(Curve=data_2, Recursive=True)  # -> Segments, Vertices
list_length = ListLength(List=explode.Segments)
equality = Equality(FirstNumber="9", SecondNumber=list_length)  # -> Equality, Inequality
stream_filter = StreamFilter(Gate=equality.Equality, Stream0=" ", Stream1="Correct!")
null_item = NullItem(Item=equality.Equality)  # -> NullFlags, InvalidFlags, Description
stream_filter_2 = StreamFilter(Gate=null_item.NullFlags, Stream0=stream_filter, Stream1=" ")
data_3 = Data(stream_filter_2)
data_4 = ClusterOutput(data_3)

# ==== cluster Checker_6
data = ClusterInput()
data_2 = Data(data)
larger_than = LargerThan(FirstNumber=data_2, SecondNumber="300")  # -> LargerThan, OrEqualTo
stream_filter = StreamFilter(Gate=larger_than.LargerThan, Stream0=" ", Stream1="Correct!")
data_3 = Data(stream_filter)
data_4 = ClusterOutput(data_3)

# ==== cluster Checker_7
data = ClusterInput()
data_2 = Data(data)
mass_addition = MassAddition(Input=data_2)  # -> Result, PartialResults
equality = Equality(FirstNumber="400", SecondNumber=mass_addition.Result)  # -> Equality, Inequality
stream_filter = StreamFilter(Gate=equality.Equality, Stream0=" ", Stream1="Correct!")
null_item = NullItem(Item=equality.Equality)  # -> NullFlags, InvalidFlags, Description
stream_filter_2 = StreamFilter(Gate=null_item.NullFlags, Stream0=stream_filter, Stream1=" ")
data_3 = Data(stream_filter_2)
data_4 = ClusterOutput(data_3)

# ==== cluster Checker_8
data = ClusterInput()
data_2 = Data(data)
brep_topology = BrepTopology(Brep=data_2, PerspectiveOnly=False)  # -> FaceFaceAdjacency, FaceEdgeAdjacency, EdgeFaceAdjacency
data_recorder = DataRecorder(data_2, DataLimit=10, RecordData=True)
list_length = ListLength(List=brep_topology.FaceEdgeAdjacency)
panel = Panel(data_recorder)
equality = Equality(FirstNumber="3", SecondNumber=list_length)  # -> Equality, Inequality
panel_2 = Panel(brep_topology.FaceEdgeAdjacency)
stream_filter = StreamFilter(Gate=equality.Equality, Stream0=" ", Stream1="Correct!")
null_item = NullItem(Item=equality.Equality)  # -> NullFlags, InvalidFlags, Description
stream_filter_2 = StreamFilter(Gate=null_item.NullFlags, Stream0=stream_filter, Stream1=" ")
data_3 = Data(stream_filter_2)
data_4 = ClusterOutput(data_3)

# ==== cluster Checker_9
data = ClusterInput()
data_2 = Data(data)
area = Area(Geometry=data_2)  # -> Area, Centroid
panel = Panel("10")
list_item = ListItem(List=area.Area, Index=0, Wrap=True)  # -> Item1, Item
larger_than = LargerThan(FirstNumber=list_item.Item1, SecondNumber=list_item.Item)  # -> LargerThan, OrEqualTo
stream_filter = StreamFilter(Gate=larger_than.LargerThan, Stream0=" ", Stream1="Correct!")
null_item = NullItem(Item=larger_than.LargerThan)  # -> NullFlags, InvalidFlags, Description
stream_filter_2 = StreamFilter(Gate=null_item.NullFlags, Stream0=stream_filter, Stream1=" ")
data_3 = Data(stream_filter_2)
data_4 = ClusterOutput(data_3)

# ==== cluster Checker_10
data = ClusterInput()
data_2 = Data(data)
volume = Volume(Geometry=data_2)  # -> Volume, Centroid
panel = Panel("10")
list_item = ListItem(List=volume.Volume, Index=0, Wrap=True)  # -> Item1, Item
larger_than = LargerThan(FirstNumber=list_item.Item1, SecondNumber=list_item.Item)  # -> LargerThan, OrEqualTo
stream_filter = StreamFilter(Gate=larger_than.LargerThan, Stream0=" ", Stream1="Correct!")
null_item = NullItem(Item=larger_than.LargerThan)  # -> NullFlags, InvalidFlags, Description
stream_filter_2 = StreamFilter(Gate=null_item.NullFlags, Stream0=stream_filter, Stream1=" ")
data_3 = Data(stream_filter_2)
data_4 = ClusterOutput(data_3)

# ==== cluster Checker_11
data = ClusterInput()
data_2 = Data(data)
number = Number(data_2)
null_item = NullItem(Item=number)  # -> NullFlags, InvalidFlags, Description
gate_not = GateNot(A=null_item.NullFlags)
stream_filter = StreamFilter(Gate=gate_not, Stream0=" ", Stream1="Correct!")
data_3 = Data(stream_filter)
data_4 = ClusterOutput(data_3)
