# Grasshopper definition GH_Challenges_E_representation.ghx (Grasshopper 0.9.76)

# Grasshopper Challenges
# By Dan Taeyoung, 2016. https://github.com/provolot/GrasshopperChallenges
# Challenges E - Grasshopper as representation tool
# Challenge E1: We need to bake a sphere, but this 90s neon green will simply not do. Change the color and bake the sphere.
construct_point = ConstructPoint(XCoordinate=0, YCoordinate=0, ZCoordinate=0)
# Challenge E2: Great, but we need more fine-tuned control; change the color with the 'Colour RGB (f)' component and bake another sphere.
construct_point_2 = ConstructPoint(XCoordinate="100", YCoordinate=0, ZCoordinate=0)
series = Series(Start=0, Step=Slider(33, range=0..100), Count=10)
# Challenge E3: We have ten spheres, but no reason why they should all be the same color. Add one 'Series' component and one 'Slider' to the Colour RGB (f) component, in order to create ten spheres that have all different colors. Bake them.
panel = Panel("200")
series_2 = Series(Start=0, Step=Slider(33, range=0..100), Count=Slider(10, range=0..20))
# Challenge E4. Let's have more free-form control over our color changes. Edit the gradient tool and bake a set of new spheres.
panel_2 = Panel("300")
series_3 = Series(Start=0, Step=Slider(33, range=0..100), Count=10)
# Challenge E5. Without adding any components, increase the number of circles to 20. Make sure to adjust the Gradient component's Lower limit and Upper limit to make this happen!
panel_3 = Panel("300")
number_slider = Slider(10, range=0..10)
construct_point_3 = ConstructPoint(XCoordinate=panel, YCoordinate=series, ZCoordinate=0)
construct_point_4 = ConstructPoint(XCoordinate=panel_2, YCoordinate=series_2, ZCoordinate=0)
sphere = Sphere(Base=construct_point, Radius=Slider(8, range=0..100))
sphere_2 = Sphere(Base=construct_point_2, Radius=Slider(8, range=0..100))
construct_point_5 = ConstructPoint(XCoordinate=panel_3, YCoordinate=series_3, ZCoordinate=0)
colour_swatch = ColourSwatch(SwatchColor=RGB(106, 250, 0))
sphere_3 = Sphere(Base=construct_point_3, Radius=Slider(9, range=0..100))
sphere_4 = Sphere(Base=construct_point_4, Radius=Slider(9, range=0..100))
series_4 = Series(Start=0, Step=1, Count=number_slider)
sphere_5 = Sphere(Base=construct_point_5, Radius=Slider(9, range=0..100))
series_5 = Series(Start=0, Step=1, Count=Slider(10, range=0..10))

# ---- group: Notice the '(f)' after the name - that means that it receives 'floating point numbers' from 0.0 to 1.0
colour_rgb_f = ColourRGBF(Alpha=1, Red=Slider(1, range=0..1), Green=Slider(1, range=0..1), Blue=Slider(1, range=0..1))

# ---- group: This very similarly named component, without the '(f)', uses numbers from 0 to 255.
colour_rgb = ColourRGB(Alpha=255, Red=0, Green=0, Blue=0)

# ---- group: Notice the '(f)' after the name - that means that it receives 'floating point numbers' from 0.0 to 1.0
colour_rgb_f_2 = ColourRGBF(Alpha=1, Red=Slider(1, range=0..1), Green=Slider(1, range=0..1), Blue=Slider(1, range=0..1))

# ----
gradient = Gradient(
    LowerLimit=Slider(0, range=0..10),
    UpperLimit=Slider(10, range=0..10),
    Parameter=series_5,
    stops=[0.15: RGB(255, 130, 160), 0.825: RGB(51, 128, 189)])
gradient_2 = Gradient(
    LowerLimit=0,
    UpperLimit=number_slider,
    Parameter=series_4,
    stops=[0: RGB(243, 57, 0), 0.1: RGB(236, 27, 60), 0.2: RGB(210, 0, 118), 0.3: RGB(103, 0, 120), 0.4: RGB(39, 72, 161), 0.5: RGB(1, 192, 229), 0.6: RGB(18, 178, 90), 0.7: RGB(79, 186, 8), 0.8: RGB(220, 237, 32), 0.9: RGB(247, 159, 20), 1: RGB(243, 57, 0)])

# ---- group: Make sure to turn this back off! Otherwise any changes will continuously bake copies.
boolean_toggle = BooleanToggle(False)

boolean_toggle_2 = BooleanToggle(False)

boolean_toggle_3 = BooleanToggle(False)

boolean_toggle_4 = BooleanToggle(False)

boolean_toggle_5 = BooleanToggle(False)

# ----
custom_preview = CustomPreview(Geometry=sphere, Shader=colour_swatch)

# ---- group: This component is from http://www.giuliopiacentino.com/grasshopper-tools/.
# (There are actually many components in other plugins that do baking, including in Lunchbox, Human, Elefront among others. Giulio Piacentino's component works without a plugin.)
bakeattributes = CSharpScript(objs=sphere, colors=colour_swatch, activate=boolean_toggle_2)  # -> out; inputs objs: list, names: list of String, layers: list of String, colors: list of Color, pWidths: list of Double, wiresEach: list of Int32, materials: list, activate: Boolean, groupListTgthr: Boolean
# ---------- bakeattributes: C# ----------
    //Inserts geometry into the Rhino document, with custom attributes
    //Written by Giulio Piacentino
    //Version written 2011 10 18 - for Grasshopper 0.8.52

    if (activate)
    {
      int groupIndex = -1;
      if(groupListTgthr)
        groupIndex = doc.Groups.Add();

      for(int i = 0; i < objs.Count; i++)
      {
        object obj = objs[i];
        if(obj == null)
        {
          Print("No object to bake");
          return;
        }

        //Make new attribute to set name
        Rhino.DocObjects.ObjectAttributes att = new Rhino.DocObjects.ObjectAttributes();

        string name = names.Count > 0 ? names[i % names.Count] : null;
        //Set object name
        if(!string.IsNullOrEmpty(name))
        {
          att.Name = name;
        }

        Color color = colors.Count > 0 ? colors[i % colors.Count] : new Color();
        //Set color
        if(!color.IsEmpty)
        {
          att.ColorSource = Rhino.DocObjects.ObjectColorSource.ColorFromObject; //Make the color type "by object"
          att.ObjectColor = color;

          att.PlotColorSource = Rhino.DocObjects.ObjectPlotColorSource.PlotColorFromObject; //Make the plot color type "by object"
          att.PlotColor = color;
        }

        string layer = layers.Count > 0 ? layers[i % layers.Count] : null;
        //Set layer
        if(!string.IsNullOrEmpty(layer) && Rhino.DocObjects.Layer.IsValidName(layer))
        {
          //Get the current layer index
          Rhino.DocObjects.Tables.LayerTable layerTable = doc.Layers;
          int layerIndex = layerTable.Find(layer, true);

          if(layerIndex < 0) //This layer does not exist, we add it
          {
            Rhino.DocObjects.Layer onlayer = new Rhino.DocObjects.Layer(); //Make a new layer
            onlayer.Name = layer;

            layerIndex = layerTable.Add(onlayer); //Add the layer to the layer table
            if (layerIndex > -1) //We manged to add layer!
            {
              att.LayerIndex = layerIndex;
              Print("Added new layer to the document at position " + layerIndex + " named " + layer + ". ");
            } else
              Print("Layer did not add. Try cleaning up your layers."); //This never happened to me.
          }
          else
            att.LayerIndex = layerIndex; //We simply add to the existing layer
        }


        double pWidth = pWidths.Count > 0 ? pWidths[i % pWidths.Count] : 0;
        //Set plotweight
        if(pWidth > 0)
        {
          att.PlotWeightSource = Rhino.DocObjects.ObjectPlotWeightSource.PlotWeightFromObject;
          att.PlotWeight = pWidth;
        }


        object material = materials.Count > 0 ? materials[i % materials.Count] : null;
        //Set material
        bool materialByName = !string.IsNullOrEmpty(material as string);
        Rhino.Display.DisplayMaterial inMaterial = material as Rhino.Display.DisplayMaterial;
        if(material is Color)
        {
          inMaterial = new Rhino.Display.DisplayMaterial((Color) material);
        }
        if(material != null && inMaterial == null && !materialByName)
        {
          if(!(material is string))
          {
            try //We also resort to try with IConvertible
            {
              inMaterial = (Rhino.Display.DisplayMaterial) Convert.ChangeType(material, typeof(Rhino.Display.DisplayMaterial));
            }
            catch(InvalidCastException)
            {
            }
          }
        }
        if(inMaterial != null || materialByName)
        {
          string matName;

          if(!materialByName)
          {
            matName = string.Format("A:{0}-D:{1}-E:{2}-S:{3},{4}-T:{5}",
              Format(inMaterial.Ambient),
              Format(inMaterial.Diffuse),
              Format(inMaterial.Emission),
              Format(inMaterial.Specular),
              inMaterial.Shine.ToString(),
              inMaterial.Transparency.ToString()
              );
          }
          else
          {
            matName = (string) material;
          }

          int materialIndex = doc.Materials.Find(matName, true);
          if(materialIndex < 0 && !materialByName) //Material does not exist and we have its specs
          {
            materialIndex = doc.Materials.Add(); //Let's add it
            if(materialIndex > -1)
            {
              Print("Added new material at position " + materialIndex + " named \"" + matName + "\". ");
              Rhino.DocObjects.Material m = doc.Materials[materialIndex];
              m.Name = matName;
              m.AmbientColor = inMaterial.Ambient;
              m.DiffuseColor = inMaterial.Diffuse;
              m.EmissionColor = inMaterial.Emission;
              //m.ReflectionColor = no equivalent
              m.SpecularColor = inMaterial.Specular;
              m.Shine = inMaterial.Shine;
              m.Transparency = inMaterial.Transparency;
              //m.TransparentColor = no equivalent
              m.CommitChanges();

              att.MaterialSource = Rhino.DocObjects.ObjectMaterialSource.MaterialFromObject;
              att.MaterialIndex = materialIndex;
            }
            else
              Print("Material did not add. Try cleaning up your materials."); //This never happened to me.
          }
          else if(materialIndex < 0 && materialByName) //Material does not exist and we do not have its specs. We do nothing
          {
            Print("Warning: material name not found. I cannot set the source to this material name. Add a material with name: " + matName);
          }
          else
          {
            //If this material exists, we do not replace it!
            att.MaterialSource = Rhino.DocObjects.ObjectMaterialSource.MaterialFromObject;
            att.MaterialIndex = materialIndex;
          }
        }


        int wires = wiresEach.Count > 0 ? wiresEach[i % wiresEach.Count] : 0;
        //Set wire density
        if(wires == -1 || wires > 0)
        {
          att.WireDensity = wires;
        }

        Bake(obj, att, groupIndex);
      }
    }
    else
    {
      Print("Inactive");
    }
# ---------- bakeattributes: C# additional code ----------
  void Bake(object obj, Rhino.DocObjects.ObjectAttributes att, int groupIndex)
  {
    if(obj == null)
      return;

    Guid id;

    //Bake to the right type of object
    if(obj is GeometryBase)
    {
      GeometryBase geomObj = obj as GeometryBase;

      switch(geomObj.ObjectType)
      {
        case Rhino.DocObjects.ObjectType.Brep:
          id = doc.Objects.AddBrep(obj as Brep, att);
          break;
        case Rhino.DocObjects.ObjectType.Curve:
          id = doc.Objects.AddCurve(obj as Curve, att);
          break;
        case Rhino.DocObjects.ObjectType.Point:
          id = doc.Objects.AddPoint((obj as Rhino.Geometry.Point).Location, att);
          break;
        case Rhino.DocObjects.ObjectType.Surface:
          id = doc.Objects.AddSurface(obj as Surface, att);
          break;
        case Rhino.DocObjects.ObjectType.Mesh:
          id = doc.Objects.AddMesh(obj as Mesh, att);
          break;
        case (Rhino.DocObjects.ObjectType) 1073741824://Rhino.DocObjects.ObjectType.Extrusion:
          id = (Guid) typeof(Rhino.DocObjects.Tables.ObjectTable).InvokeMember("AddExtrusion", BindingFlags.Instance | BindingFlags.InvokeMethod, null, doc.Objects, new object[]{obj, att});
          break;
        case Rhino.DocObjects.ObjectType.PointSet:
          id = doc.Objects.AddPointCloud(obj as Rhino.Geometry.PointCloud, att); //This is a speculative entry
          break;
        default:
          Print("The script does not know how to handle this type of geometry: " + obj.GetType().FullName);
          return;
      }
    }
    else
    {
      Type objectType = obj.GetType();

      if(objectType == typeof(Arc))
      {
        id = doc.Objects.AddArc((Arc) obj, att);
      }
      else if(objectType == typeof(Box))
      {
        id = doc.Objects.AddBrep(((Box) obj).ToBrep(), att);
      }
      else if(objectType == typeof(Circle))
      {
        id = doc.Objects.AddCircle((Circle) obj, att);
      }
      else if(objectType == typeof(Ellipse))
      {
        id = doc.Objects.AddEllipse((Ellipse) obj, att);
      }
      else if(objectType == typeof(Polyline))
      {
        id = doc.Objects.AddPolyline((Polyline) obj, att);
      }
      else if(objectType == typeof(Sphere))
      {
        id = doc.Objects.AddSphere((Sphere) obj, att);
      }
      else if(objectType == typeof(Point3d))
      {
        id = doc.Objects.AddPoint((Point3d) obj, att);
      }
      else if(objectType == typeof(Line))
      {
        id = doc.Objects.AddLine((Line) obj, att);
      }
      else if(objectType == typeof(Vector3d))
      {
        Print("Impossible to bake vectors");
        return;
      }
      else if(obj is IEnumerable)
      {
        int newGroupIndex;
        if(groupIndex == -1)
          newGroupIndex = doc.Groups.Add();
        else
          newGroupIndex = groupIndex;
        foreach(object o in obj as IEnumerable)
        {
          Bake(o, att, newGroupIndex);
        }
        return;
      }
      else
      {
        Print("Unhandled type: " + objectType.FullName);
        return;
      }
    }

    if(groupIndex != -1)
    {
      doc.Groups.AddToGroup(groupIndex, id);
      Print("Added " + obj.GetType().Name + " to group number " + groupIndex);
    }
    else
      Print("Added " + obj.GetType().Name);
  }

  static string Format(Color c)
  {
    return (new System.Text.StringBuilder("A")).Append(c.A.ToString()).Append("R").Append(c.R.ToString()).Append("G")
      .Append(c.G.ToString()).Append("B").Append(c.B.ToString()).ToString();
  }
# ---------- end bakeattributes ----------

# ----
colour = Colour(colour_rgb_f_2)
colour_2 = Colour(gradient)
colour_3 = Colour(gradient_2)
bakeattributes_2 = CSharpScript(objs=sphere_2, colors=colour_rgb_f, activate=boolean_toggle)  # -> out; inputs objs: list, names: list of String, layers: list of String, colors: list of Color, pWidths: list of Double, wiresEach: list of Int32, materials: list, activate: Boolean, groupListTgthr: Boolean; same code as bakeattributes
custom_preview_2 = CustomPreview(Geometry=sphere_2, Shader=colour_rgb_f)
custom_preview_3 = CustomPreview(Geometry=sphere_3, Shader=colour)
bakeattributes_3 = CSharpScript(objs=sphere_3, colors=colour, activate=boolean_toggle_3)  # -> out; inputs objs: list, names: list of String, layers: list of String, colors: list of Color, pWidths: list of Double, wiresEach: list of Int32, materials: list, activate: Boolean, groupListTgthr: Boolean; same code as bakeattributes
custom_preview_4 = CustomPreview(Geometry=sphere_4, Shader=colour_2)
bakeattributes_4 = CSharpScript(objs=sphere_4, colors=colour_2, activate=boolean_toggle_4)  # -> out; inputs objs: list, names: list of String, layers: list of String, colors: list of Color, pWidths: list of Double, wiresEach: list of Int32, materials: list, activate: Boolean, groupListTgthr: Boolean; same code as bakeattributes
custom_preview_5 = CustomPreview(Geometry=sphere_5, Shader=colour_3)
bakeattributes_5 = CSharpScript(objs=sphere_5, colors=colour_3, activate=boolean_toggle_5)  # -> out; inputs objs: list, names: list of String, layers: list of String, colors: list of Color, pWidths: list of Double, wiresEach: list of Int32, materials: list, activate: Boolean, groupListTgthr: Boolean; same code as bakeattributes
checker = Checker(colour=colour)
panel_4 = Panel(checker)

# ==== cluster Checker
colour = ClusterInput()
split_argb = SplitARGB(Colour=colour)  # -> Alpha, Red, Green, Blue
relative_differences = RelativeDifferences(Values=split_argb.Red)
relative_differences_2 = RelativeDifferences(Values=split_argb.Green)
relative_differences_3 = RelativeDifferences(Values=split_argb.Blue)
average = Average(Input=relative_differences)
average_2 = Average(Input=relative_differences_2)
average_3 = Average(Input=relative_differences_3)
mass_addition = MassAddition(Input=[average, average_2, average_3])  # -> Result, PartialResults
larger_than = LargerThan(FirstNumber=mass_addition.Result, SecondNumber="0.001")  # -> LargerThan, OrEqualTo
stream_filter = StreamFilter(Gate=larger_than.LargerThan, Stream0=" ", Stream1="Correct!")
data = Data(stream_filter)
data_2 = ClusterOutput(data)
panel = Panel(mass_addition.Result)
