# Grasshopper definition GH_Tutorials_H_GettingDataInAndOut.ghx (Grasshopper 1.0.7)

# Saving Grasshopper Data!
# Okay --- this is super funky.
# You can save any kind of geometry with Grasshopper to a file!
# 
# And even more interestingly, Grasshopper will auto-load this.
# 
# This means that you can have Grasshopper sharing data between instances of Rhino..
# 
# Or, if you use Dropbox / Google Drive or some other auto-syncing mechanism, you can easily share data over the network!
number_slider = Slider(6, range=0..10)
# Saving text files!
# You can save files with Python.. but you can also use Grasshopper.
number_slider_2 = Slider(4, range=0..10)

# ---- group: unfortunately https doesn't seem to work sometimes
# Getting data in/out of Grasshopper
# Using Python to do a GET request and parse JSON!
panel = Panel("http://feeds.citibikenyc.com/stations/stations.json")

# ----
series = Series(Start=number_slider, Step=1, Count=Slider(10, range=0..100))
# Reading text files!
file_path = FilePath("C:\Users\provolot\github\PaperHopper_metatool\.gitignore")
series_2 = Series(Start=number_slider_2, Step=1, Count=Slider(10, range=0..100))
# Change this and watch this change!
panel_2 = Panel(file_path)
read_file = ReadFile(File=file_path, PerLineParse=True)
panel_3 = Panel(series)
sphere = Sphere(Base=PlaneXY(0, 0, 0), Radius=Slider(3, range=0..10))
# Right click and select "Stream Destination" to select location..
# 
# Then right click again and toggle "Stream Contents" to start saving data to a file. Untoggle this to stop.
panel_4 = Panel(series_2)

# ---- group: This is the component that does the JSON reading.
getjson = PythonScript(URL=panel, Activate=Toggle(False))  # -> data, JSON, PathStructure, IDs, Values; inputs Activate: Boolean
# ---------- getjson: Python ----------
import json
import array
import urllib2
import rhinoscriptsyntax as rs
import clr
import Grasshopper
from Grasshopper.Kernel.Data import GH_Path
from Grasshopper import DataTree

def traverseJson(fragment, thispath, prevkey, toReturn):
    thistext = ""
    if(type(fragment) == dict):
        for i in xrange(len(fragment.keys())):
            thispath.append(i)
            thiskey = fragment.keys()[i]
            thistext += traverseJson(fragment[thiskey], thispath, thiskey, toReturn)
            thispath.pop()
        return thistext
    if(type(fragment) == list):
        for i in xrange(len(fragment)):
            thispath.append(i)
            thistext += traverseJson(fragment[i], thispath, prevkey, toReturn)
            thispath.pop()
        return thistext    
        
        
    if(fragment != None):
        if(toReturn == "paths"):
            return unicode(thispath) + "\n"
        if(toReturn == "ids"):
            return prevkey + "\n"
        if(toReturn == "values"):
            return unicode(fragment) + "\n"
        
    else:
        return ""
    
    
def JSONtoTREE(json):
    global PathStructure
    global IDs
    global Values
    
    IDtree = DataTree[object]()
    Valuetree = DataTree[object]()
    
    path = []
    
    PathStructure = traverseJson(json, path, "", "paths").splitlines();
    IDs = traverseJson(json, path, "", "ids").splitlines()
    Values = traverseJson(json, path, "", "values").splitlines()
    NewPathStructure = []
    for i in xrange(len(PathStructure)):
        thispath = PathStructure[i]
        thispath = map(lambda x: int(x), thispath.replace("]","").replace("[","").split(","))
        #print GH_Path(thispath
        newarray = array.array('i')
        newarray.fromlist(thispath)
        IDtree.Add(IDs[i], GH_Path(*newarray))
        Valuetree.Add(Values[i], GH_Path(*newarray))
        
    IDs = IDtree
    Values = Valuetree
    
    return str(json)
    

if(Activate == True):
    
    if URL:
        data = urllib2.urlopen(URL).read()
        data = json.loads(data)
      
        JSON = JSONtoTREE(data)
        
    else:
        if Path:
            
            file = open(Path)
            data = json.load(file)
            JSON = JSONtoTREE(data)
            
        else:
            if Text:
                data = json.loads(Text)
                JSON = JSONtoTREE(data)
# ---------- end getjson ----------

# ----
panel_5 = Panel(read_file)
data_output = DataOutput(
    somedata=panel_3,
    somegeo=sphere,
    Destination="\Dropbox\RMIT Teaching\2019 COMS 2\Downloads\test1.ghdata",
    RelativePath="\Dropbox\RMIT Teaching\2019 COMS 2\Downloads\test1.ghdata")
trim_tree = TrimTree(Tree=getjson.Values, Depth=1)
list_item = ListItem(List=trim_tree, Index=Slider(3, range=0..10), Wrap=True)  # -> Item, Item1
construct_point = ConstructPoint(XCoordinate=list_item.Item, YCoordinate=list_item.Item1, ZCoordinate=0)
number_slider_3 = Slider(11, range=0..100)  # disabled
# You can right-click to set the name of the input file. You can also set the delay, so that file changes aren't reflected immediately.
data_input = DataInput(
    Destination="\Dropbox\RMIT Teaching\2019 COMS 2\Downloads\test1.ghdata",
    RelativePath="\Dropbox\RMIT Teaching\2019 COMS 2\Downloads\test1.ghdata",
    UpdateDelay=5)  # -> somedata, somegeo
number_slider_4 = Slider(0.003, range=0..0.1)  # disabled
number_slider_5 = Slider(0.001, range=0..0.01)  # disabled
panel_6 = Panel(data_input.somedata)
panel_7 = Panel(data_input.somegeo)
list_item_2 = ListItem(List=trim_tree, Index=number_slider_3, Wrap=True)  # -> Item, Item1; disabled
multiplication = Multiplication(A=number_slider_5, B=list_item_2.Item)  # disabled
cone = Cone(Base=construct_point, Radius=number_slider_4, Length=multiplication)  # -> Cone, Tip; disabled
colour_swatch = ColourSwatch(SwatchColor=RGB(103, 221, 235))  # disabled
custom_preview = CustomPreview(Geometry=cone.Cone, Material=colour_swatch)  # disabled
panel_8 = Panel(trim_tree)
ghpython_script = GhPythonScript(x=Slider(7, range=0..10))  # -> out, a
# ---------- ghpython_script: Python ----------
from scriptcontext import sticky

sticky["test"] = x
# ---------- end ghpython_script ----------
ghpython_script_2 = GhPythonScript(x=Slider(5, range=0..10))  # -> result, out
# ---------- ghpython_script_2: Python ----------
from scriptcontext import sticky


result = sticky["test"]
# ---------- end ghpython_script_2 ----------
panel_9 = Panel(ghpython_script_2.result)
panel_10 = Panel(ghpython_script.a)
